# Grasshopper definition CALCULUS_operationsOnFunctions_004.gh (Grasshopper 1.0.8)
# plug-ins: RhinoCodePluginGH

number_slider = Slider(10, range=-10..10)
number_slider_2 = Slider(-10, range=-10..10)
# Created at
# Wickerson Studios
# copyright 2024
# download all materials at
# www.wickersonstudios.com
# Visualizing Calculus Algorithm
# from
# gpt Image Prompt
number_slider_3 = Slider(100, range=1..100)
operationsonfunctions_004 = Script(
    numPoints=number_slider_3,
    freqX=Slider(3, range=0.1..3),
    ampX=Slider(3, range=0.1..3),
    freqY=Slider(3, range=0.1..3),
    ampY=Slider(3, range=0.1..3),
    height=Slider(10, range=-10..10))  # -> out, A, B, C; inputs numPoints: Int32, freqX: Double, ampX: Double, freqY: Double, ampY: Double, height: Double
# ---------- operationsonfunctions_004: C# ----------
using System;
using System.Collections.Generic;
using Rhino.Geometry;

public class Script_Instance : GH_ScriptInstance
{
    private void RunScript(
	int numPoints,
	double freqX,
	double ampX,
	double freqY,
	double ampY,
	double height,
	ref object A,
	ref object B,
	ref object C)
    {
        // Initialize lists for points, curves, and pipes
        List<Point3d> points = new List<Point3d>();
        List<Curve> curves = new List<Curve>();
        List<Brep> pipes = new List<Brep>();

        // Generate points based on complex trigonometric functions
        for (int i = 0; i < numPoints; i++)
        {
            double t = i * (2 * Math.PI / numPoints);
            double x = ampX * Math.Sin(freqX * t) + 5 * Math.Sin(2 * freqX * t);
            double y = ampY * Math.Cos(freqY * t) + 5 * Math.Cos(2 * freqY * t);
            double z = height * (t / (2 * Math.PI));
            points.Add(new Point3d(x, y, z));
        }

        // Create interpolated curve through points
        if (points.Count > 1)
        {
            Curve curve = Curve.CreateInterpolatedCurve(points, 3);
            if (curve != null)
            {
                curves.Add(curve);

                // Create varying-radius circles and sweep them along the curve
                SweepOneRail sweep = new SweepOneRail();
                sweep.AngleToleranceRadians = Math.PI / 10;
                sweep.ClosedSweep = false;
                sweep.SweepTolerance = 0.001;
                sweep.SetToRoadlikeTop();

                List<Curve> circles = new List<Curve>();
                for (double t = 0; t <= 1; t += 0.05)
                {
                    Point3d point = curve.PointAtNormalizedLength(t);
                    double radius = 0.5 + 0.5 * Math.Sin(4 * Math.PI * t); // Varying radius between 0.5 and 1.0
                    Circle circle = new Circle(point, radius);
                    circles.Add(circle.ToNurbsCurve());
                }

                Brep[] breps = sweep.PerformSweep(curve, circles);
                if (breps != null)
                {
                    pipes.AddRange(breps);
                }
            }
        }

        // Output the points, curves, and pipes
        A = points;
        B = curves;
        C = pipes;
    }
}
# ---------- end operationsonfunctions_004 ----------
geometry = Geometry(operationsonfunctions_004.A)
geometry_2 = Geometry(operationsonfunctions_004.C)
geometry_3 = Geometry(operationsonfunctions_004.B)
panel = Panel(operationsonfunctions_004.out)
panel_2 = Panel([geometry, geometry_3, geometry_2])
entwine = Entwine(Branch00=geometry, Branch01=geometry_3, Branch02=geometry_2, FlattenInputs=True)
param_viewer = ParamViewer(entwine)
