# Grasshopper definition algorithms_interlocking_001.gh (Grasshopper 1.0.8)
# plug-ins: RhinoCodePluginGH

mesh_sphere = MeshSphere(Base=PlaneXY(0, 0, 0), Radius=10, UCount=10, VCount=20)
sudivision_001 = Script(x=mesh_sphere)  # -> out, A; inputs x: Mesh
# ---------- sudivision_001: C# ----------
//Grasshopper Script Instance
//#! csharp
using System;
using System.Collections;
using System.Collections.Generic;
using System.Drawing;

using Rhino;
using Rhino.Geometry;

using Grasshopper;
using Grasshopper.Kernel;
using Grasshopper.Kernel.Data;
using Grasshopper.Kernel.Types;

public class Script_Instance : GH_ScriptInstance
{
    private void RunScript(Mesh x, ref object A)
    {
        // Initialize the output
        A = null;

        // Check if input is a mesh
        if (!(x is Mesh))
        {
            Print("Input must be a mesh.");
            return;
        }

        Mesh inputMesh = x as Mesh;

        // Ensure the mesh is triangulated
        inputMesh.Faces.ConvertQuadsToTriangles();

        // Placeholder for the resulting list of subdivided meshes
        List<Mesh> subdividedMeshes = new List<Mesh>();

        // Implement the subdivision algorithm here
        // For demonstration, we'll simply clone the input mesh
        // Replace this with the actual subdivision logic
        Mesh subdividedMesh = inputMesh.DuplicateMesh();
        
        // Normally, you would apply your subdivision logic here
        // For example, Loop subdivision or any other algorithm

        // Add the subdivided mesh to the list
        subdividedMeshes.Add(subdividedMesh);

        // Set the output
        A = subdividedMeshes;
    }

    // <Custom additional code> 
}
# ---------- end sudivision_001 ----------
geometry = Geometry(sudivision_001.A)
param_viewer = ParamViewer(geometry)
panel = Panel(geometry)
# Created at
# Wickerson Studios
# copyright 2024
# download all materials at
# www.wickersonstudios.com
panel_2 = Panel(sudivision_001.out)
# Parametric Subdivision Algorithm from
# gpt Image Prompt
number_slider = Slider(4, range=0..10)
mesh_sphere_2 = MeshSphere(Base=PlaneXY(0, 0, 0), Radius=10, UCount=number_slider, VCount=number_slider)
triangulate = Triangulate(Mesh=mesh_sphere_2)  # -> Mesh, Count
sudivision_002 = Script(x=triangulate.Mesh, y=Slider(2, range=0..3))  # -> out, A; inputs x: Mesh, y: Int32
# ---------- sudivision_002: C# ----------
//Grasshopper Script Instance
//#! csharp
using System;
using System.Collections.Generic;
using Rhino.Geometry;

public class Script_Instance : GH_ScriptInstance
{
    private void RunScript(Mesh x, int y, ref object A)
    {
        if (x == null || !x.IsValid || y < 1)
        {
            A = x;
            return;
        }

        Mesh subdividedMesh = x.DuplicateMesh();
        for (int i = 0; i < y; i++)
        {
            subdividedMesh = SubdivideMesh(subdividedMesh);
        }

        A = subdividedMesh;
    }

    // Recursive subdivision method
    private Mesh SubdivideMesh(Mesh mesh)
    {
        Mesh newMesh = new Mesh();

        foreach (MeshFace face in mesh.Faces)
        {
            if (face.IsTriangle)
            {
                Point3d v0 = mesh.Vertices[face.A];
                Point3d v1 = mesh.Vertices[face.B];
                Point3d v2 = mesh.Vertices[face.C];

                // Create midpoints
                Point3d m01 = (v0 + v1) / 2;
                Point3d m12 = (v1 + v2) / 2;
                Point3d m20 = (v2 + v0) / 2;

                // Add vertices and faces to the new mesh
                int i0 = newMesh.Vertices.Add(v0);
                int i1 = newMesh.Vertices.Add(v1);
                int i2 = newMesh.Vertices.Add(v2);
                int im01 = newMesh.Vertices.Add(m01);
                int im12 = newMesh.Vertices.Add(m12);
                int im20 = newMesh.Vertices.Add(m20);

                newMesh.Faces.AddFace(i0, im01, im20);
                newMesh.Faces.AddFace(im01, i1, im12);
                newMesh.Faces.AddFace(im20, im12, i2);
                newMesh.Faces.AddFace(im01, im12, im20);
            }
            else
            {
                // Handle non-triangular faces (if necessary)
            }
        }

        newMesh.Normals.ComputeNormals();
        newMesh.Compact();

        return newMesh;
    }

    // <Custom additional code> 
}
# ---------- end sudivision_002 ----------
geometry_2 = Geometry(sudivision_002.A)
panel_3 = Panel(sudivision_002.out)
panel_4 = Panel(geometry_2)
param_viewer_2 = ParamViewer(geometry_2)
