# Grasshopper definition architecture_robotArm_001.gh (Grasshopper 1.0.8)
# plug-ins: RhinoCodePluginGH

number_slider = Slider(0.82, range=0..1)  # disabled
number_slider_2 = Slider(0.79, range=0..1)  # disabled
number_slider_3 = Slider(0.79, range=0..1)  # disabled
number_slider_4 = Slider(0, range=0..1)  # disabled
number_slider_5 = Slider(1, range=0..1)  # disabled
number_slider_6 = Slider(0.3, range=0..1)  # disabled
number_slider_7 = Slider(7.7, range=0..20)  # disabled
number_slider_8 = Slider(10.8, range=0..20)  # disabled
number_slider_9 = Slider(4.5, range=0..20)  # disabled
number_slider_10 = Slider(5.4, range=0..20)  # disabled
number_slider_11 = Slider(7.7, range=0..20)  # disabled
number_slider_12 = Slider(101.9, range=0..200)  # disabled
number_slider_13 = Slider(5, range=0..10)  # disabled
number_slider_14 = Slider(25.9, range=0..100)  # disabled
number_slider_15 = Slider(7.5, range=0..10)  # disabled
number_slider_16 = Slider(19.5, range=0..100)  # disabled
number_slider_17 = Slider(7.7, range=0..20)  # disabled
number_slider_18 = Slider(101.9, range=0..200)  # disabled
number_slider_19 = Slider(5, range=0..10)  # disabled
number_slider_20 = Slider(25.9, range=0..100)  # disabled
number_slider_21 = Slider(7.5, range=0..10)  # disabled
number_slider_22 = Slider(19.5, range=0..100)  # disabled
number_slider_23 = Slider(10.9, range=0..20)  # disabled
number_slider_24 = Slider(101.9, range=0..200)  # disabled
number_slider_25 = Slider(5, range=0..10)  # disabled
number_slider_26 = Slider(25.9, range=0..100)  # disabled
number_slider_27 = Slider(7.5, range=0..10)  # disabled
number_slider_28 = Slider(19.5, range=0..100)  # disabled
vector_xyz = VectorXYZ(XComponent=number_slider, YComponent=0, ZComponent=0)  # -> Vector, Length; disabled
vector_xyz_2 = VectorXYZ(XComponent=0, YComponent=number_slider_3, ZComponent=0)  # -> Vector, Length; disabled
vector_xyz_3 = VectorXYZ(XComponent=number_slider_2, YComponent=0, ZComponent=0)  # -> Vector, Length; disabled
vector_xyz_4 = VectorXYZ(XComponent=0, YComponent=number_slider_4, ZComponent=0)  # -> Vector, Length; disabled
robotarm_004 = Script(
    baseScale=number_slider_5,
    firstSegmentLength=number_slider_7,
    secondSegmentLength=number_slider_9,
    firstSegmentRotation=vector_xyz.Vector,
    secondSegmentRotation=vector_xyz_2.Vector)  # -> out, A; inputs baseScale: Double, firstSegmentLength: Double, secondSegmentLength: Double, firstSegmentRotation: Vector3d, secondSegmentRotation: Vector3d; disabled
# ---------- robotarm_004: C# ----------
using System;
using System.Collections.Generic;
using Rhino.Geometry;

public class Script_Instance : GH_ScriptInstance
{
  private void RunScript(
	double baseScale,
	double firstSegmentLength,
	double secondSegmentLength,
	Vector3d firstSegmentRotation,
	Vector3d secondSegmentRotation,
	ref object A)
  {
    try
    {
      var breps = new List<Brep>();

      // Initialize the base plane at the world origin
      Plane basePlane = Plane.WorldXY;

      // Create base
      Brep baseBrep = CreateBase(baseScale);
      breps.Add(baseBrep);

      // Move the plane to the top of the base to start the first arm segment
      basePlane.Translate(new Vector3d(0, 0, baseScale * 2)); // Assuming the height of the base is twice its radius

      // Create and orient the first arm segment
      Brep firstArmBrep = CreateArmSegment(firstSegmentLength, baseScale);
      firstArmBrep.Transform(RotateArmSegment(ref basePlane, firstSegmentRotation));
      breps.Add(firstArmBrep);

      // Create and orient the second arm segment
      Brep secondArmBrep = CreateArmSegment(secondSegmentLength, baseScale * 0.75); // Slightly smaller scale for the second segment
      secondArmBrep.Transform(RotateArmSegment(ref basePlane, secondSegmentRotation));
      breps.Add(secondArmBrep);

      // Create gripper
      Brep gripperBrep = CreateGripper(baseScale * 0.5);
      breps.Add(gripperBrep);

      // Set the output
      A = breps;
    }
    catch (Exception ex)
    {
      // Catch the innermost exception and send the message to the output
      while (ex.InnerException != null) ex = ex.InnerException;
      A = ex.Message;
    }
  }

  // Method to create the base of the arm
  Brep CreateBase(double scale)
  {
    var baseCircle = new Circle(Plane.WorldXY, scale);
    var baseCylinder = new Cylinder(baseCircle, scale * 2); // Height is twice the radius
    return baseCylinder.ToBrep(true, true);
  }

  // Method to create a segment of the arm
  Brep CreateArmSegment(double length, double scale)
  {
    var segmentCircle = new Circle(Plane.WorldXY, scale);
    var segmentCylinder = new Cylinder(segmentCircle, length);
    return segmentCylinder.ToBrep(true, true);
  }

  // Method to orient an arm segment
  Transform RotateArmSegment(ref Plane plane, Vector3d rotation)
  {
    // Applying rotation using Euler angles
    var rotateX = Transform.Rotation(rotation.X, Vector3d.XAxis, plane.Origin);
    var rotateY = Transform.Rotation(rotation.Y, Vector3d.YAxis, plane.Origin);
    var rotateZ = Transform.Rotation(rotation.Z, Vector3d.ZAxis, plane.Origin);
    
    // Combine rotations in X, Y, Z order (this is a simplification and does not represent quaternion rotation)
    Transform rotationTransform = rotateX * rotateY * rotateZ;

    // Update the plane orientation with the new rotation
    plane.Transform(rotationTransform);

    return rotationTransform;
  }

  // Method to create the gripper
  Brep CreateGripper(double scale)
  {
    // Simplified representation of a gripper
    var gripperBaseCircle = new Circle(Plane.WorldXY, scale);
    var gripperCylinder = new Cylinder(gripperBaseCircle, scale * 0.5); // Half the scale for the gripper length
    return gripperCylinder.ToBrep(true, true);
  }
  
  // <Custom additional code> 
}
# ---------- end robotarm_004 ----------
robotarm_005 = Script(
    baseScale=number_slider_6,
    firstSegmentLength=number_slider_8,
    secondSegmentLength=number_slider_10,
    firstSegmentRotation=vector_xyz_3.Vector,
    secondSegmentRotation=vector_xyz_4.Vector)  # -> out, A; inputs baseScale: Double, firstSegmentLength: Double, secondSegmentLength: Double, firstSegmentRotation: Vector3d, secondSegmentRotation: Vector3d; disabled
# ---------- robotarm_005: C# ----------
using System;
using System.Collections.Generic;
using Rhino.Geometry;

public class Script_Instance : GH_ScriptInstance
{
  private void RunScript(
    double baseScale,
    double firstSegmentLength,
    double secondSegmentLength,
    Vector3d firstSegmentRotation,
    Vector3d secondSegmentRotation,
    ref object A)
  {
    try
    {
      var breps = new List<Brep>();

      // Initialize the base plane at the world origin
      Plane basePlane = Plane.WorldXY;

      // Create base
      Brep baseBrep = CreateBase(baseScale);
      breps.Add(baseBrep);

      // Move the plane to the top of the base to start the first arm segment
      basePlane.Translate(new Vector3d(0, 0, baseScale * 2)); // Assuming the height of the base is twice its radius

      // Create and orient the first arm segment
      Brep firstArmBrep = CreateArmSegment(firstSegmentLength, baseScale);
      Plane firstSegmentPlane = new Plane(basePlane.Origin, basePlane.XAxis, basePlane.YAxis);
      firstArmBrep.Transform(Transform.PlaneToPlane(Plane.WorldXY, firstSegmentPlane));
      firstArmBrep.Transform(RotateArmSegment(firstSegmentRotation));
      breps.Add(firstArmBrep);

      // Adjust plane for the second segment
      Plane secondSegmentPlane = new Plane(firstSegmentPlane);
      secondSegmentPlane.Translate(secondSegmentPlane.ZAxis * firstSegmentLength);
      secondSegmentPlane.Transform(RotateArmSegment(firstSegmentRotation));
      secondSegmentPlane.Transform(RotateArmSegment(secondSegmentRotation));

      // Create and orient the second arm segment
      Brep secondArmBrep = CreateArmSegment(secondSegmentLength, baseScale * 0.75);
      secondArmBrep.Transform(Transform.PlaneToPlane(Plane.WorldXY, secondSegmentPlane));
      breps.Add(secondArmBrep);

      // Set the output
      A = breps;
    }
    catch (Exception ex)
    {
      // Catch the innermost exception and send the message to the output
      while (ex.InnerException != null) ex = ex.InnerException;
      A = ex.Message;
    }
  }

  // Method to create the base of the arm
  Brep CreateBase(double scale)
  {
    var baseCircle = new Circle(Plane.WorldXY, scale);
    var baseCylinder = new Cylinder(baseCircle, scale * 2); // Height is twice the radius
    return baseCylinder.ToBrep(true, true);
  }

  // Method to create a segment of the arm
  Brep CreateArmSegment(double length, double scale)
  {
    var segmentCircle = new Circle(Plane.WorldXY, scale);
    var segmentCylinder = new Cylinder(segmentCircle, length);
    return segmentCylinder.ToBrep(true, true);
  }

  // Method to apply rotation to an arm segment
  Transform RotateArmSegment(Vector3d rotation)
  {
    // Applying rotation using Euler angles
    var rotationX = Transform.Rotation(rotation.X, Vector3d.XAxis, Plane.WorldXY.Origin);
    var rotationY = Transform.Rotation(rotation.Y, Vector3d.YAxis, Plane.WorldXY.Origin);
    var rotationZ = Transform.Rotation(rotation.Z, Vector3d.ZAxis, Plane.WorldXY.Origin);
    
    // Combine rotations in X, Y, Z order
    Transform rotationTransform = rotationX * rotationY * rotationZ;
    
    return rotationTransform;
  }

  // No need to create the gripper as it is not included in the RunScript parameters
}
# ---------- end robotarm_005 ----------
robotarm_001 = Script()  # -> out, A; disabled
# ---------- robotarm_001: C# ----------
using System;
using System.Collections.Generic;
using System.Drawing;
using Rhino.Geometry;
using Rhino.DocObjects;
using System.Linq;

public class Script_Instance : GH_ScriptInstance
{
  #region Members
    /// <summary>List of error messages. Do not modify this list directly.</summary>
    private List<string> __err = new List<string>();

    /// <summary>List of print messages. Do not modify this list directly, use the Print and Reflect methods instead.</summary>
    private List<string> __out = new List<string>();

    /// <summary>"Global" variable that is persistent between calls to RunScript.</summary>
    private object __persistent;

    /// <summary>The current Rhino document.</summary>
    private Rhino.RhinoDoc RhinoDocument;

    /// <summary>The current Grasshopper document.</summary>
    private Grasshopper.Kernel.GH_Document GrasshopperDocument;

    /// <summary>The Grasshopper script component which owns this script.</summary>
    private Grasshopper.Kernel.IGH_Component Component;

    /// <summary>
    /// This method will be called once every solution, before any calls to RunScript are made.
    /// </summary>
    public override void BeforeRunScript()
    {
      RhinoDocument = Rhino.RhinoDoc.ActiveDoc;
    }
  #endregion

  private void RunScript(object x, object y, ref object A)
  {
    // Create a list to store the parts of the robotic arm as separate geometries
    List<GeometryBase> parts = new List<GeometryBase>();

    // Here you would put your logic for creating the parts of the robot
    // For example, a simple placeholder for a cylinder part:
    double radius = 10.0; // placeholder value
    double height = 50.0; // placeholder value
    Plane basePlane = Plane.WorldXY;
    Circle baseCircle = new Circle(basePlane, radius);
    Cylinder cylinder = new Cylinder(baseCircle, height);
    Brep brepCylinder = cylinder.ToBrep(true, true);
    parts.Add(brepCylinder);

    // Add other parts, each with their own specific characteristics

    // Set the output
    A = parts;
  }

  // <Custom additional code> 
}
# ---------- end robotarm_001 ----------
robotarm_002 = Script()  # -> out, A; disabled
# ---------- robotarm_002: C# ----------
using System;
using System.Collections.Generic;
using Rhino.Geometry;

public class Script_Instance : GH_ScriptInstance
{
  private void RunScript(object x, object y, ref object A)
  {
    var breps = new List<Brep>();

    // Create base
    Brep baseBrep = CreateBase();
    breps.Add(baseBrep);

    // Create first arm segment
    Brep firstArmBrep = CreateFirstArmSegment();
    breps.Add(firstArmBrep);

    // Create second arm segment
    Brep secondArmBrep = CreateSecondArmSegment();
    breps.Add(secondArmBrep);

    // Continue for additional segments...

    // End effector (gripper)
    Brep gripperBrep = CreateGripper();
    breps.Add(gripperBrep);

    A = breps;
  }

  // Methods to create each part of the arm
  Brep CreateBase()
  {
    var baseCircle = new Circle(Plane.WorldXY, 50);
    var baseCylinder = new Cylinder(baseCircle, 20);
    return baseCylinder.ToBrep(true, true);
  }

  Brep CreateFirstArmSegment()
  {
    var baseCircle = new Circle(Plane.WorldXY, 30);
    var armCylinder = new Cylinder(baseCircle, 100);
    return armCylinder.ToBrep(true, true);
  }

  Brep CreateSecondArmSegment()
  {
    var baseCircle = new Circle(Plane.WorldXY, 20);
    var armCylinder = new Cylinder(baseCircle, 80);
    return armCylinder.ToBrep(true, true);
  }

  Brep CreateGripper()
  {
    var baseCircle = new Circle(Plane.WorldXY, 10);
    var gripperCylinder = new Cylinder(baseCircle, 10);
    return gripperCylinder.ToBrep(true, true);
  }

  // <Custom additional code> 
}
# ---------- end robotarm_002 ----------
robotarm_003 = Script()  # -> out, A; disabled
# ---------- robotarm_003: C# ----------
using System;
using System.Collections.Generic;
using Rhino.Geometry;

public class Script_Instance : GH_ScriptInstance
{
  private void RunScript(ref object A)
  {
    var breps = new List<Brep>();

    // Initialize the base plane
    Plane basePlane = Plane.WorldXY;

    // Create base
    Brep baseBrep = CreateBase(ref basePlane);
    breps.Add(baseBrep);

    // Create first arm segment
    Brep firstArmBrep = CreateFirstArmSegment(ref basePlane);
    breps.Add(firstArmBrep);

    // The basePlane is now updated to the end of the first segment
    // Create second arm segment
    Brep secondArmBrep = CreateSecondArmSegment(ref basePlane);
    breps.Add(secondArmBrep);

    // The basePlane is now updated to the end of the second segment
    // End effector (gripper)
    Brep gripperBrep = CreateGripper(ref basePlane);
    breps.Add(gripperBrep);

    A = breps;
  }

  // Methods to create each part of the arm
  Brep CreateBase(ref Plane plane)
  {
    var baseCircle = new Circle(plane, 50);
    var baseCylinder = new Cylinder(baseCircle, 20);
    return baseCylinder.ToBrep(true, true);
  }

  Brep CreateFirstArmSegment(ref Plane plane)
  {
    // Adjust plane to position the first arm segment
    plane.Translate(new Vector3d(0, 0, 20)); // Move up from base
    var baseCircle = new Circle(plane, 30);
    var armCylinder = new Cylinder(baseCircle, 100);
    var brep = armCylinder.ToBrep(true, true);

    // Update plane to end of the first arm segment
    plane.Translate(new Vector3d(0, 0, 100)); // Move up the length of the first arm segment
    return brep;
  }

  Brep CreateSecondArmSegment(ref Plane plane)
  {
    // Adjust plane for the second arm segment
    var baseCircle = new Circle(plane, 20);
    var armCylinder = new Cylinder(baseCircle, 80);
    var brep = armCylinder.ToBrep(true, true);

    // Update plane to end of the second arm segment
    plane.Translate(new Vector3d(0, 0, 80)); // Move up the length of the second arm segment
    return brep;
  }

  Brep CreateGripper(ref Plane plane)
  {
    // Adjust plane for the gripper
    var gripperBaseCircle = new Circle(plane, 10);
    var gripperCylinder = new Cylinder(gripperBaseCircle, 10);
    return gripperCylinder.ToBrep(true, true);
  }
}
# ---------- end robotarm_003 ----------
param_viewer = ParamViewer(robotarm_004.A)  # disabled
param_viewer_2 = ParamViewer(robotarm_005.A)  # disabled
panel = Panel(robotarm_004.out)  # disabled
panel_2 = Panel(robotarm_005.out)  # disabled
panel_3 = Panel(robotarm_004.A)  # disabled
panel_4 = Panel(robotarm_005.A)  # disabled
param_viewer_3 = ParamViewer(robotarm_003.A)  # disabled
panel_5 = Panel(robotarm_003.out)  # disabled
panel_6 = Panel(robotarm_003.A)  # disabled
panel_7 = Panel(robotarm_002.out)  # disabled
panel_8 = Panel(robotarm_002.A)  # disabled
panel_9 = Panel(robotarm_001.A)  # disabled
panel_10 = Panel(robotarm_001.out)  # disabled
# Parametric Robot Arm from
# gpt Image Prompt
number_slider_29 = Slider(0.79, range=0..1)
# Created at
# Wickerson Studios
# copyright 2024
# download all materials at
# www.wickersonstudios.com
number_slider_30 = Slider(0.3, range=0..1)
vector_xyz_5 = VectorXYZ(XComponent=number_slider_29, YComponent=Slider(0.23, range=0..1), ZComponent=Slider(0, range=0..1))  # -> Vector, Length
vector_xyz_6 = VectorXYZ(XComponent=Slider(0.75, range=0..1), YComponent=Slider(0.33, range=0..1), ZComponent=Slider(0, range=0..1))  # -> Vector, Length
robotarm_006 = Script(
    baseScale=number_slider_30,
    firstSegmentLength=Slider(10.8, range=0..20),
    secondSegmentLength=Slider(5.4, range=0..20),
    firstSegmentRotation=vector_xyz_5.Vector,
    secondSegmentRotation=vector_xyz_6.Vector)  # -> out, A; inputs baseScale: Double, firstSegmentLength: Double, secondSegmentLength: Double, firstSegmentRotation: Vector3d, secondSegmentRotation: Vector3d
# ---------- robotarm_006: C# ----------
using System;
using System.Collections.Generic;
using Rhino.Geometry;

public class Script_Instance : GH_ScriptInstance
{
  private void RunScript(
    double baseScale,
    double firstSegmentLength,
    double secondSegmentLength,
    Vector3d firstSegmentRotation,
    Vector3d secondSegmentRotation,
    ref object A)
  {
    try
    {
      var breps = new List<Brep>();

      // Initialize the base plane at the world origin
      Plane basePlane = Plane.WorldXY;

      // Create base
      Brep baseBrep = CreateBase(baseScale);
      breps.Add(baseBrep);

      // Move the plane to the top of the base to start the first arm segment
      basePlane.Translate(new Vector3d(0, 0, baseScale * 2)); // Assuming the height of the base is twice its radius

      // Create and orient the first arm segment
      Brep firstArmBrep = CreateArmSegment(firstSegmentLength, baseScale);
      Transform firstSegmentTransform = RotateArmSegment(ref basePlane, firstSegmentRotation);
      firstArmBrep.Transform(firstSegmentTransform);
      breps.Add(firstArmBrep);

      // The second segment's base plane starts at the end of the first and is oriented by the first's rotation
      Plane secondSegmentBasePlane = new Plane(basePlane);
      secondSegmentBasePlane.Translate(secondSegmentBasePlane.ZAxis * firstSegmentLength); // Move to end of the first segment

      // Create and orient the second arm segment
      Brep secondArmBrep = CreateArmSegment(secondSegmentLength, baseScale * 0.75);
      Transform secondSegmentTransform = RotateArmSegment(ref secondSegmentBasePlane, secondSegmentRotation);
      secondArmBrep.Transform(Transform.PlaneToPlane(Plane.WorldXY, secondSegmentBasePlane));
      breps.Add(secondArmBrep);

      // Set the output
      A = breps;
    }
    catch (Exception ex)
    {
      // Catch the innermost exception and send the message to the output
      while (ex.InnerException != null) ex = ex.InnerException;
      A = ex.Message;
    }
  }

  // Method to create the base of the arm
  Brep CreateBase(double scale)
  {
    var baseCircle = new Circle(Plane.WorldXY, scale);
    var baseCylinder = new Cylinder(baseCircle, scale * 2); // Height is twice the radius
    return baseCylinder.ToBrep(true, true);
  }

  // Method to create a segment of the arm
  Brep CreateArmSegment(double length, double scale)
  {
    var segmentCircle = new Circle(Plane.WorldXY, scale);
    var segmentCylinder = new Cylinder(segmentCircle, length);
    return segmentCylinder.ToBrep(true, true);
  }

  // Method to apply rotation to an arm segment
  Transform RotateArmSegment(ref Plane plane, Vector3d rotation)
  {
    // Applying rotation using Euler angles
    Transform rotationTransform = Transform.Identity;
    if (rotation != Vector3d.Zero)
    {
      rotationTransform = Transform.Rotation(rotation.X, plane.XAxis, plane.Origin) *
                          Transform.Rotation(rotation.Y, plane.YAxis, plane.Origin) *
                          Transform.Rotation(rotation.Z, plane.ZAxis, plane.Origin);
    }
    
    // Update the plane orientation with the new rotation
    plane.Transform(rotationTransform);
    return rotationTransform;
  }

  // <Custom additional code> 
}
# ---------- end robotarm_006 ----------
param_viewer_4 = ParamViewer(robotarm_006.A)
panel_11 = Panel(robotarm_006.out)
panel_12 = Panel(robotarm_006.A)
